# Dynamo graph blog04.dyn "VC Str Analysis in Dynamo (20201102)" (Dynamo 2.1.0.7500)

# group: Matrix Inversion (LU Decomposition)
test_cases = CodeBlock()
# ---------- test_cases.designscript (16 lines) ----------
MA = [[1,1,0,3],
      [2,1,-1,1],
      [3,-1,-1,2],
      [-1,2,3,-1]];

MB = [[2,1,4],
      [8,-3,2],
      [4,11,-1]];

MC = [[1,2,4],
      [3,8,14],
      [2,6,13]];

MD = [[2,4,6],
      [0,-1,-8],
      [0,0,96]];
# ----------------------------------------
matrix_inverse = Python(IN[0]=test_cases.MA)
# ---------- matrix_inverse.python (78 lines) ----------
# Enable Python support and load DesignScript library
import clr
import math
clr.AddReference('ProtoGeometry')
from Autodesk.DesignScript.Geometry import *

# The inputs to this node will be stored as a list in the IN variables.
dataEnteringNode = IN

# Place your code below this line
M = IN[0] #Input Matrix

def Matrix_Mult(M1, M2):
    M3 = [[0 for j in range(0,len(M2[0]))] for i in range(0,len(M1))] 
    for i in range(0,len(M3)):
        for j in range(0,len(M3[i])):
            Val_M3 = 0
            for p in range(0,len(M1[0])):
                Val_M1 = M1[i][p]
                Val_M2 = M2[p][j]
                Val_M3 += Val_M1 * Val_M2
            M3[i][j] = Val_M3
    return M3

def Matrix_Inv_Tri(Type, M):
    M_r = [[0 for j in range(0,len(M[i])*2)] for i in range(0,len(M))]
    for i in range(0,len(M)): 
        M_r[i][len(M)+i] = 1.0
        for j in range(0,len(M[i])): M_r[i][j] = M[i][j]
    if Type == "Upper": 
        for i in range(0,len(M_r)): 
            ind = len(M_r)-1-i; Coeff = 1.0*M_r[ind][ind]
            for j in range(0,len(M_r[i])): M_r[ind][j] = M_r[ind][j] / Coeff
            for p in range(0,i):
                ind_n = ind+p+1; Coeff = 1.0*M_r[ind][ind_n]
                for q in range(0,len(M_r[ind])): M_r[ind][q] -= Coeff * M_r[ind_n][q]
    elif Type == "Lower":
        for i in range(0,len(M_r)): 
            Coeff = 1.0*M_r[i][i]
            for j in range(0,len(M_r[i])): M_r[i][j] = M_r[i][j] / Coeff
            for p in range(0,i):
                ind_n = i-p-1; Coeff = 1.0*M_r[i][ind_n]
                for q in range(0,len(M_r[i])): M_r[i][q] -= Coeff * M_r[ind_n][q]
    M_inv = [[0 for j in range(0,len(M[i]))] for i in range(0,len(M))]
    for i in range(0,len(M)): 
        for j in range(0,len(M[i])): M_inv[i][j] = M_r[i][j+len(M)]   
    return M_inv 

def Matrix_Inv_LU(M, Output_Components = "No"):
    L_r = [[0 for j in range(0,len(M[i]))] for i in range(0,len(M))]
    U_r = [[0 for j in range(0,len(M[i]))] for i in range(0,len(M))]
    for i in range(0,len(M)): 
        U_r[0][i] = M[0][i]
        for j in range(0,len(M[i])): 
            if i == j: L_r[i][j] = 1.0
            elif j == 0: L_r[i][j] = M[i][j] / U_r[0][0]
    for i in range(1,len(M)):
        for j in range(0,len(M[i])):
            if j >= i: 
                U_0 = 0
                for p in range(0,i): U_0 += L_r[i][0+p] * U_r[0+p][j]
                U_r[i][j] = M[i][j] - U_0 
            if j < i and j > 0:
                L_0 = 0
                for q in range(0,j): L_0 += L_r[i][0+q] * U_r[0+q][j]
                L_r[i][j] = (M[i][j] - L_0) / U_r[j][j]
    U_inv = Matrix_Inv_Tri("Upper", U_r)
    L_inv = Matrix_Inv_Tri("Lower", L_r) 
    M_inv = Matrix_Mult(U_inv, L_inv)
    Output = M_inv
    if Output_Components == "Yes": Output = M_inv, L_r, U_r, L_inv, U_inv
    return Output
   
#Output
M_inv, L_r, U_r, L_inv, U_inv = Matrix_Inv_LU(M, Output_Components = "Yes")

# Assign your output to the OUT variable.
OUT = M_inv, L_r, U_r, L_inv, U_inv
# ----------------------------------------
m_inv = CodeBlock(IN=matrix_inverse) { IN[0]; }
L = CodeBlock(IN=matrix_inverse) { IN[1]; }
U = CodeBlock(IN=matrix_inverse) { IN[2]; }
l_inv = CodeBlock(IN=matrix_inverse) { IN[3]; }
u_inv = CodeBlock(IN=matrix_inverse) { IN[4]; }

show_example = DoubleSlider(4, range=1..5 step 1)
force_scale_drawn = DoubleSlider(0.8, range=0.1..3 step 0.1)
example_1 = CodeBlock()
# ---------- example_1.designscript (21 lines) ----------
//Joint Data = [Name, Restraint (F=Free), Coord (XYZ mm), Jt Forces (kN)]
Set_X = 0;
Set_Y = 0;
Jt_A = ["A", ["F", "R", "F"], [Set_X + 0, Set_Y, 6000], [0, 0, 0]];
Jt_B = ["B", ["F", "F", "F"], [Set_X + 6000, Set_Y, 6000], [5, 0, 0]];
Jt_C = ["C", ["R", "R", "R"], [Set_X + 6000, Set_Y, 0], [0, 0, 0]];
Jt_Info = [Jt_B, Jt_A, Jt_C];

//Material Property = [Elastic Mod MPa, MOI mm4, Area mm2]
E_m = 200000;
I_m = 60*1000000;
A_m = 600;
Prop = [E_m, A_m, I_m];

//Member data = [Name, Jt_i, Jt_j, UDL (kN/m), Material Property]
Mbr_1 = ["Mbr 1", "A", "B", 0, Prop];
Mbr_2 = ["Mbr 2", "B", "C", 0, Prop];
Mbr_Info = [Mbr_1, Mbr_2];

//Input Summary
Input = [Jt_Info, Mbr_Info];
# ----------------------------------------

# group: Examples
examples_1_2_3_verified_based_on = CodeBlock()  # "Examples 1, 2 & 3 verified based on link below"; //Examples 1~3 from https://www.erbakan.edu.tr/storage/files/department/insaatmuhendisligi/editor/DersSayfalari/YapSt2/07_Matrix_Frame.pdf
example_2 = CodeBlock()
# ---------- example_2.designscript (21 lines) ----------
//Joint Data = [Name, Restraint (F=Free), Coord (XYZ mm), Jt Forces (kN)]
Set_X = 0;
Set_Y = 0;
Jt_A = ["A", ["R", "R", "R"], [Set_X + 0, Set_Y, 0], [0, 0, 0]];
Jt_B = ["B", ["F", "F", "F"], [Set_X + 6000, Set_Y, 4500], [0, 0, 0]];
Jt_C = ["C", ["R", "R", "R"], [Set_X + 12000, Set_Y, 4500], [0, 0, 0]];
Jt_Info = [Jt_B, Jt_A, Jt_C];

//Material Property = [Elastic Mod MPa, MOI mm4, Area mm2]
E_m = 200000;
I_m = 60*1000000;
A_m = 600;
Prop = [E_m, A_m, I_m];

//Member data = [Name, Jt_i, Jt_j, UDL (kN/m), Material Property]
Mbr_1 = ["Mbr 1", "A", "B", 0.0, Prop];
Mbr_2 = ["Mbr 2", "B", "C", 3.0, Prop];
Mbr_Info = [Mbr_1, Mbr_2];

//Input Summary
Input = [Jt_Info, Mbr_Info];
# ----------------------------------------
example_3 = CodeBlock()
# ---------- example_3.designscript (23 lines) ----------
//Joint Data = [Name, Restraint (F=Free), Coord (XYZ mm), Jt PVM (kN,kN,kNm)]
Set_X = 0;
Set_Y = 0;
Jt_A = ["A", ["R", "R", "R"], [Set_X + 0, Set_Y, 0], [0, 0, 0]];
Jt_B = ["B", ["F", "F", "F"], [Set_X + 6000, Set_Y, 4500], [15.0, 0, 20.0]];
Jt_C = ["C", ["F", "F", "F"], [Set_X + 9000, Set_Y, 4500], [0, -10.0, 0]];
Jt_D = ["D", ["R", "R", "R"], [Set_X + 12000, Set_Y, 4500], [0, 0, 0]];
Jt_Info = [Jt_A, Jt_B, Jt_C, Jt_D];

//Material Property = [Elastic Mod MPa, MOI mm4, Area mm2]
E_m = 200000;
I_m = 60*1000000;
A_m = 600;
Prop = [E_m, A_m, I_m];

//Member data = [Name, Jt_i, Jt_j, UDL (kN/m), Material Property]
Mbr_1 = ["Mbr 1", "A", "B", 3.0, Prop];
Mbr_2 = ["Mbr 2", "B", "C", 0.0, Prop];
Mbr_3 = ["Mbr 3", "C", "D", 0.0, Prop];
Mbr_Info = [Mbr_1, Mbr_2, Mbr_3];

//Input Summary
Input = [Jt_Info, Mbr_Info];
# ----------------------------------------
example_4_custom = CodeBlock()
# ---------- example_4_custom.designscript (21 lines) ----------
//Joint Data = [Name, Restraint (F=Free), Coord (XYZ mm), Jt Forces (kN)]
Set_X = 0;
Set_Y = 0;
Jt_A = ["A", ["R", "R", "R"], [Set_X + 0, Set_Y, 0], [0, 0, 0]];
Jt_B = ["B", ["F", "F", "F"], [Set_X + 5000, Set_Y, 0], [0, 0, 0]];
Jt_C = ["C", ["R", "R", "F"], [Set_X + 10000, Set_Y, 0], [0, 0, 0]];
Jt_Info = [Jt_B, Jt_A, Jt_C];

//Material Property = [Elastic Mod MPa, MOI mm4, Area mm2]
E_m = 200000;
I_m = 60*1000000;
A_m = 600;
Prop = [E_m, A_m, I_m];

//Member data = [Name, Jt_i, Jt_j, UDL (kN/m), Material Property]
Mbr_1 = ["Mbr 1", "A", "B", 5, Prop];
Mbr_2 = ["Mbr 2", "B", "C", 5, Prop];
Mbr_Info = [Mbr_1, Mbr_2];

//Input Summary
Input = [Jt_Info, Mbr_Info];
# ----------------------------------------
example_5_custom = CodeBlock()
# ---------- example_5_custom.designscript (33 lines) ----------
//Joint Data = [Name, Restraint (F=Free), Coord (XYZ mm), Jt PVM (kN,kN,kNm)]
Set_X = 0;
Set_Y = 0;
Jt_A = ["A", ["R", "R", "R"], [Set_X + 0, Set_Y, 0], [0, 0, 0]];
Jt_B = ["B", ["F", "F", "F"], [Set_X + 0, Set_Y, 5000], [0, 0, 0]];
Jt_C = ["C", ["F", "F", "F"], [Set_X + 0, Set_Y, 10000], [0, 0, 0]];
Jt_D = ["D", ["F", "F", "F"], [Set_X + 0, Set_Y, 15000], [0, 0, 0]];
Jt_E = ["E", ["R", "R", "R"], [Set_X + 5000, Set_Y, 0], [0, 0, 0]];
Jt_F = ["F", ["F", "F", "F"], [Set_X + 5000, Set_Y, 5000], [5, 0, 0]];
Jt_G = ["G", ["F", "F", "F"], [Set_X + 5000, Set_Y, 10000], [5, 0, 0]];
Jt_H = ["H", ["F", "F", "F"], [Set_X + 5000, Set_Y, 15000], [5, 0, 0]];
Jt_Info = [Jt_A, Jt_B, Jt_C, Jt_D, Jt_E, Jt_F, Jt_G, Jt_H];

//Material Property = [Elastic Mod MPa, MOI mm4, Area mm2]
E_m = 200000;
I_m = 60*1000000;
A_m = 600;
Prop = [E_m, A_m, I_m];

//Member data = [Jt_i, Jt_j, UDL (kN/m), Material Property]
Mbr_1 = ["Mbr 1", "A", "B", 0.0, Prop];
Mbr_2 = ["Mbr 2", "B", "C", 0.0, Prop];
Mbr_3 = ["Mbr 3", "C", "D", 0.0, Prop];
Mbr_4 = ["Mbr 4", "E", "F", 0.0, Prop];
Mbr_5 = ["Mbr 5", "F", "G", 0.0, Prop];
Mbr_6 = ["Mbr 6", "G", "H", 0.0, Prop];
Mbr_7 = ["Mbr 7", "B", "F", 0.0, Prop];
Mbr_8 = ["Mbr 8", "C", "G", 0.0, Prop];
Mbr_9 = ["Mbr 9", "D", "H", 0.0, Prop];
Mbr_Info = [Mbr_1, Mbr_2, Mbr_3, Mbr_4, Mbr_5, Mbr_6, Mbr_7, Mbr_8, Mbr_9];

//Input Summary
Input = [Jt_Info, Mbr_Info];
# ----------------------------------------
code_block = CodeBlock(E1=example_1.Input, E2=example_2.Input, E3=example_3.Input, E4=example_4_custom.Input, E5=example_5_custom.Input)
# ---------- code_block.designscript (4 lines) ----------
Example =
[E1, E2,
E3, E4,
E5];
# ----------------------------------------

# group: Structural Analysis
violet_cloud_ai = CodeBlock()  # //Please visit www.violetcloud.ai
code_block_2 = CodeBlock(Show_Ex=show_example, P_Scale=force_scale_drawn, V_Scale=force_scale_drawn, M_Scale=force_scale_drawn)
# ---------- code_block_2.designscript (5 lines) ----------
Ctrl =
[Show_Ex,
P_Scale,
V_Scale,
M_Scale];
# ----------------------------------------
structural_analysis = Python(IN[0]=code_block_2, IN[1]=code_block)
# ---------- structural_analysis.python (830 lines) ----------
# Enable Python support and load DesignScript library
import clr
import math
clr.AddReference('ProtoGeometry')
from Autodesk.DesignScript.Geometry import *


# The inputs to this node will be stored as a list in the IN variables.
dataEnteringNode = IN

# Place your code below this line
Show_Ex = int(IN[0][0])
Force_Scale = IN[0][1:]
Examples = IN[1]
Jt_Info, Mbr_Info = Examples[Show_Ex-1]

Text_Size = 420
Text_Shift_r = 0.3
Dynamo_Offset = 0.9*Text_Size
Model_Size = 100
Dim_D = Model_Size
Dim_B = Model_Size
Sphere_Rad = Model_Size
d0_Tol = 5 * math.pi/180.0 #deg to rad
dL_Tol = 10 #in mm
dr_Tol = 0.001

Draw_Ref = ["Framing", "Applied Loads", "Internal Forces", "Reactions", "Dimensions"]
Draw_Data = [[] for i in range(0,len(Draw_Ref))]

############################## Control Functions ########################################
def Frame_Analysis(Jt_List, Mbr_List):
    ind_Name, ind_Res, ind_Jt, ind_Force, ind_React, ind_Defl, ind_Int_F = 0, 1, 2, 3, 4, 5, 5; DOF = 3
    #Joint numbering references and 0 terms
    Jt_Lib = []
    for i in range(0,len(Jt_List)):
        Jt_Lib += [Jt_List[i][ind_Name]]
        Ini_Reaction = [0,0,0]
        Ini_Defl = [0,0,0]
        Jt_List[i] += [Ini_Reaction, Ini_Defl]
    #Global K
    Gl_K = [[0 for j in range(0,len(Jt_List)*DOF)] for i in range(0,len(Jt_List)*DOF)]
    for j in range(0,len(Mbr_List)):
        Mbr_Name, Name_i, Name_j, Mbr_UDL, Mat_Prop = Mbr_List[j]
        Ini_Int_F = [0,0,0,0,0,0]
        Mbr_List[j] += [Ini_Int_F]
        ind_i = Jt_Lib.index(Name_i); Jt_i = Jt_List[ind_i][ind_Jt]
        ind_j = Jt_Lib.index(Name_j); Jt_j = Jt_List[ind_j][ind_Jt]
        V_n, M_n = End_Forces(Jt_i, Jt_j, Mbr_UDL)
        Mbr_F = [0.0, V_n, M_n, 0.0, V_n, -M_n]
        Gl_Mbr_F = Transform_Forces("Global", Jt_i, Jt_j, Mbr_F)
        Jt_List[ind_i][ind_Force][0] -= Gl_Mbr_F[0]
        Jt_List[ind_i][ind_Force][1] -= Gl_Mbr_F[1]
        Jt_List[ind_i][ind_Force][2] -= Gl_Mbr_F[2]
        Jt_List[ind_j][ind_Force][0] -= Gl_Mbr_F[3]
        Jt_List[ind_j][ind_Force][1] -= Gl_Mbr_F[4]
        Jt_List[ind_j][ind_Force][2] -= Gl_Mbr_F[5]
        Lc_K = Plane_K(Jt_i, Jt_j, Mat_Prop) #in kN, m
        for p in range(0,len(Lc_K)):
            for q in range(0,len(Lc_K[p])):
                if p > 2: ii = ind_j*DOF + p - DOF  
                else: ii = ind_i*DOF + p
                if q > 2: jj = ind_j*DOF + q - DOF
                else: jj = ind_i*DOF + q
                Gl_K[ii][jj] += Lc_K[p][q]
    #Joint numbering references and 0 terms
    Gl_F, Gl_K_null = [], []
    for i in range(0,len(Jt_List)):
        Jt_Force = Jt_List[i][ind_Force]
        Jt_Res = Jt_List[i][ind_Res]
        for j in range(0,DOF):
            if Jt_Res[j] == "R": Gl_K_null += [i*DOF + j]
            else: Gl_F += [[Jt_Force[j]]] 
    #Global K for Unrestrained DOF
    Gl_K_mod, Gl_ind = [], []
    for i in range(0,len(Gl_K)):
        if i not in Gl_K_null:
            Gl_K_row = []
            for j in range(0,len(Gl_K[i])):
                if j not in Gl_K_null:
                    Gl_K_row += [Gl_K[i][j]]
            Gl_K_mod += [Gl_K_row]; Gl_ind += [i]
    #Global Displacement/Rotation
    Inv_K = Matrix_Inv_LU(Gl_K_mod)
    Gl_D = Matrix_Mult(Inv_K, Gl_F) #in m, rad
    for i in range(0,len(Jt_List)):
        for j in range(0,3):
            ind = i*DOF + j
            for q in range(0,len(Gl_D)):
                if ind == Gl_ind[q]: Jt_List[i][ind_Defl][j] = Gl_D[q][0]; break
    #Local Forces
    for j in range(0,len(Mbr_List)):
        Mbr_Name, Name_i, Name_j, Mbr_UDL, Mat_Prop, Int_F = Mbr_List[j]
        ind_i = Jt_Lib.index(Name_i); Jt_i = Jt_List[ind_i][ind_Jt]
        ind_j = Jt_Lib.index(Name_j); Jt_j = Jt_List[ind_j][ind_Jt]
        Lc_K = Plane_K(Jt_i, Jt_j, Mat_Prop)
        Lc_D = [[0] for p in range(0,2*DOF)]
        for p in range(0,DOF*2):
            Lc_ind = ind_i*DOF + p
            if p > 2: Lc_ind = ind_j*DOF + p - DOF  
            for q in range(0,len(Gl_D)):
                if Lc_ind == Gl_ind[q]: Lc_D[p] = Gl_D[q]; break
        #Global/Local Internal Forces
        Gl_M_F = Matrix_Mult(Lc_K, Lc_D)
        Gl_M_Fr = []
        for p in range(0,len(Gl_M_F)): Gl_M_Fr += [Gl_M_F[p][0]]
        Lc_M_F = Transform_Forces("Local", Jt_i, Jt_j, Gl_M_Fr)
        V_n, M_n = End_Forces(Jt_i, Jt_j, Mbr_UDL)
        Lc_Jt_F = [0.0, V_n, M_n, 0.0, V_n, -M_n]
        Lc_F_r = [] 
        for p in range(0,len(Lc_M_F)): Mbr_List[j][ind_Int_F][p] += (Lc_M_F[p] + Lc_Jt_F[p])
        #Reactions
        Lc_F_r = Mbr_List[j][ind_Int_F]
        Gl_F_r = Transform_Forces("Global", Jt_i, Jt_j, Lc_F_r)
        for i in range(0,len(Lc_F_r)): 
            if i > 2: Jt_List[ind_j][ind_React][i-DOF] += Gl_F_r[i]
            else: Jt_List[ind_i][ind_React][i] += Gl_F_r[i]
    return Mbr_List, Inv_K, Gl_K_mod, Gl_D, Gl_F


def Frame_Draw(Action, Jt_List, Mbr_List, Force_Scale, Draw_Data):
    ind_Name, ind_Res, ind_Jt, ind_Force, ind_React = 0, 1, 2, 3, 4; DOF = 3
    Jt_Lib = []; X_Store, Z_Store = [], [] #Y_Store = []
    for i in range(0,len(Jt_List)):
        Jt_Name = Jt_List[i][ind_Name]
        Coord = Jt_List[i][ind_Jt]
        Jt_Lib += [Jt_List[i][ind_Name]]
        X_Store += [Coord[0]] #Y_Store += [Coord[1]]
        Z_Store += [Coord[2]]
    X_min, X_max, Z_min, Z_max = min(X_Store), max(X_Store), min(Z_Store), max(Z_Store)
    d_X = X_max - X_min 
    d_Z = Z_max - Z_min  
    if Action == "Initial":
        #Titles
        Title_List = ["Model & Dimensions:", "Reactions & Deformation:", "Axial Force Diagram (AFD):", "Shear Force Diagram (SFD):", "Bending Moment Diagram (BMD):"]
        Draw_ind_List = ["Dimensions", "Reactions", "Internal Forces", "Internal Forces", "Internal Forces"]
        Name_ind_List = ["Model", "Reaction", "AFD", "SFD", "BMD"]
        for p in range(0,len(Title_List)):
            Jt_m = [0, 0, Z_min + d_Z + 5000 - Text_Size * p]
            MText = Title_List[p]
            Text_Info = [Jt_m, MText, Draw_ind_List[p]]
            Draw_Text(Name_ind_List[p], "Title", Text_Info, Draw_Data)
        #Model X & Z Dimensions
        Colour = "Violet"; Gap = 500; Leader = 500; Ext = 250; Arrow_Size = 250
        Draw_Type = "Dimensions"
        Dim_Info = Draw_Type, Colour, Gap, Leader, Ext, Arrow_Size
        X_Set = sorted(set(X_Store))
        Z_Set = sorted(set(Z_Store))
        for i in range(0,len(X_Set)-1): #Dimension in X
            Jt_i = [X_Set[i], 0, Z_Set[0]]
            Jt_j = [X_Set[i+1], 0, Z_Set[0]]
            Draw_Dimension(Jt_i, Jt_j, Dim_Info, Draw_Data)
        for j in range(0,len(Z_Set)-1): #Dimension in Z
            Jt_i = [X_Set[0], 0, Z_Set[j]]
            Jt_j = [X_Set[0], 0, Z_Set[j+1]]
            Draw_Dimension(Jt_i, Jt_j, Dim_Info, Draw_Data)
        #Draw Joints and Joint Loads
        for i in range(0,len(Jt_List)): #Joints
            Jt_Name, Restraint, Coord, Forces = Jt_List[i]
            Colour = "Black"; Supp_Size = 250; Jt_0 = Coord
            Draw_Info = [Jt_Name, Colour, Supp_Size, Restraint]
            Draw_Support("Model", Jt_0, Draw_Info, Draw_Data)
            Colour = "Blue"; Force_Dir = "L"
            if Coord[0] > (X_min + d_X/2.0): Force_Dir = "R"
            Draw_Info = [Jt_Name, Colour, Coord, Forces, Arrow_Size, Force_Dir]
            Ansys_Loads("Model Joint", Draw_Info, Draw_Data)
        #Draw Frame Members and Frame Loads
        for j in range(0,len(Mbr_List)): #Frames
            Mbr_Name, Name_i, Name_j, Mbr_UDL, Mat_Prop = Mbr_List[j]
            Colour = "Black"; Cyl_Rad = 100
            ind_i = Jt_Lib.index(Name_i); Jt_1 = Jt_List[ind_i][ind_Jt]
            ind_j = Jt_Lib.index(Name_j); Jt_2 = Jt_List[ind_j][ind_Jt]
            Member_Info = [Mbr_Name, Colour, Cyl_Rad, Jt_1, Jt_2]
            Frame_Member("Model", Member_Info, Draw_Data) #Allow for Model option, 3D
            Colour = "Blue"
            Draw_Info = [Mbr_Name, Colour, Jt_1, Jt_2, Mbr_UDL, Arrow_Size]
            Ansys_Loads("Model Member", Draw_Info, Draw_Data)
    elif Action == "Results":
        #Draw Reaction
        for i in range(0,len(Jt_List)):
            Arrow_Size = 250
            Jt_Name, Restraint, Coord, Forces, Reaction, Defl = Jt_List[i]
            Colour = "Red"
            React_Dir = "L"
            if Coord[0] > (X_min + d_X/2.0): React_Dir = "R"
            Draw_Info = [Jt_Name, Colour, Coord, Reaction, Defl, Restraint, Arrow_Size, React_Dir]
            Ansys_Loads("Model Reaction", Draw_Info, Draw_Data)
        #Draw Axial Force Diagram, Shear Force Diagram, Bending Moment Diagram
        for j in range(0,len(Mbr_List)):
            Mbr_Name, Name_i, Name_j, Mbr_UDL, Mat_Prop, Mbr_Forces = Mbr_List[j]
            ind_i = Jt_Lib.index(Name_i); Jt_1 = Jt_List[ind_i][ind_Jt]
            ind_j = Jt_Lib.index(Name_j); Jt_2 = Jt_List[ind_j][ind_Jt]
            Draw_Info = [Mbr_Name, Mbr_UDL, Mbr_Forces, Force_Scale]
            Ansys_Internal_Forces("Model Axial", Jt_1, Jt_2, Draw_Info, Draw_Data)
            Ansys_Internal_Forces("Model Shear", Jt_1, Jt_2, Draw_Info, Draw_Data)
            Ansys_Internal_Forces("Model Bending", Jt_1, Jt_2, Draw_Info, Draw_Data)

############################## Structural Analysis Functions ########################################

def Transform_Forces(Action, Jt_i, Jt_j, Force_Matrix):
    if Action == "Global": Angle_B = Plane_Angle(Jt_i, Jt_j)
    else: Angle_B = -Plane_Angle(Jt_i, Jt_j)
    P_i, V_i, M_i, P_j, V_j, M_j = Force_Matrix
    TP_i, Dummy, TV_i = Plane_Rot(P_i, 0, V_i, Angle_B)
    TP_j, Dummy, TV_j = Plane_Rot(P_j, 0, V_j, Angle_B)  
    Output = [TP_i, TV_i, M_i, TP_j, TV_j, M_j]
    return Output

def End_Forces(Jt_i, Jt_j, Mbr_UDL):        
    Len = Dist(Jt_i, Jt_j)
    V_n = Mbr_UDL * Len / 2.0 / 1000 #in kN
    M_n = Mbr_UDL * Len**2 / 12.0 / 1000**2 #in kNm
    return V_n, M_n
    
def Plane_K(Jt_i, Jt_j, Mat_Prop): #Stiffness Matrix, XZ Plane
    E_m, A_m, I_m = Mat_Prop #in MPa, mm2, mm4
    L_m = Dist(Jt_i, Jt_j) #in mm
    E_m = E_m*1.0 * 1000 #MPa to kPa
    A_m = A_m*1.0 / 1000**2 #to m2
    I_m = I_m*1.0 / 1000**4 #to m4
    L_m = L_m*1.0 / 1000 #to m
    Angle_B = Plane_Angle(Jt_i, Jt_j)
    n_ix = math.cos(Angle_B) 
    n_iy = math.sin(Angle_B)
    n_jx = math.cos(Angle_B)
    n_jy = math.sin(Angle_B)

    P_cf = (1.0 * A_m * E_m) / L_m
    V_cf = (12.0 * E_m * I_m) / (L_m**3)
    M_cf = (6.0 * E_m * I_m) / (L_m**2)
    R_cf = (2.0 * E_m * I_m) / L_m
    
    PiPi =  P_cf*n_ix**2   + V_cf*n_iy**2
    PiVi =  P_cf*n_ix*n_iy - V_cf*n_ix*n_iy
    PiMi = -M_cf*n_iy
    PiPj = -P_cf*n_ix*n_jx - V_cf*n_iy*n_jy
    PiVj = -P_cf*n_ix*n_jy + V_cf*n_iy*n_jx
    PiMj = -M_cf*n_iy
    
    ViPi =  P_cf*n_ix*n_iy - V_cf*n_ix*n_iy
    ViVi =  P_cf*n_iy**2   + V_cf*n_ix**2
    ViMi =  M_cf*n_ix
    ViPj = -P_cf*n_iy*n_jx + V_cf*n_ix*n_jy
    ViVj = -P_cf*n_iy*n_jy - V_cf*n_ix*n_jx
    ViMj =  M_cf*n_ix
    
    MiPi = -M_cf*n_iy
    MiVi =  M_cf*n_ix
    MiMi =  2.0*R_cf
    MiPj =  M_cf*n_jy
    MiVj = -M_cf*n_jx
    MiMj =  R_cf
    
    PjPi = -P_cf*n_ix*n_jx - V_cf*n_iy*n_jy
    PjVi = -P_cf*n_iy*n_jx + V_cf*n_ix*n_jy
    PjMi =  M_cf*n_jy
    PjPj =  P_cf*n_jx**2   + V_cf*n_jy**2
    PjVj =  P_cf*n_jx*n_jy - V_cf*n_jx*n_jy
    PjMj =  M_cf*n_jy
    
    VjPi = -P_cf*n_ix*n_jy + V_cf*n_iy*n_jx
    VjVi = -P_cf*n_iy*n_jy - V_cf*n_ix*n_jx
    VjMi = -M_cf*n_jx
    VjPj =  P_cf*n_jx*n_jy - V_cf*n_jx*n_jy
    VjVj =  P_cf*n_jy**2   + V_cf*n_jx**2
    VjMj = -M_cf*n_jx
    
    MjPi = -M_cf*n_iy
    MjVi =  M_cf*n_ix
    MjMi =  R_cf
    MjPj =  M_cf*n_jy
    MjVj = -M_cf*n_jx
    MjMj =  2.0*R_cf

    Pi_ij = [PiPi, PiVi, PiMi, PiPj, PiVj, PiMj]
    Vi_ij = [ViPi, ViVi, ViMi, ViPj, ViVj, ViMj]
    Mi_ij = [MiPi, MiVi, MiMi, MiPj, MiVj, MiMj]
    Pj_ij = [PjPi, PjVi, PjMi, PjPj, PjVj, PjMj]
    Vj_ij = [VjPi, VjVi, VjMi, VjPj, VjVj, VjMj]
    Mj_ij = [MjPi, MjVi, MjMi, MjPj, MjVj, MjMj]
     
    K_Matrix = [Pi_ij, Vi_ij, Mi_ij, Pj_ij, Vj_ij, Mj_ij] #Units in kN, m
    return K_Matrix


def Matrix_Mult(M1, M2):
    M3 = [[0 for j in range(0,len(M2[0]))] for i in range(0,len(M1))] 
    for i in range(0,len(M3)):
        for j in range(0,len(M3[i])):
            Val_M3 = 0
            for p in range(0,len(M1[0])):
                Val_M1 = M1[i][p]
                Val_M2 = M2[p][j]
                Val_M3 += Val_M1 * Val_M2
            M3[i][j] = Val_M3
    return M3


def Matrix_Inv_Tri(Type, M):
    M_r = [[0 for j in range(0,len(M[i])*2)] for i in range(0,len(M))]
    for i in range(0,len(M)): 
        M_r[i][len(M)+i] = 1.0
        for j in range(0,len(M[i])): M_r[i][j] = M[i][j]
    if Type == "Upper": 
        for i in range(0,len(M_r)): 
            ind = len(M_r)-1-i; Coeff = 1.0*M_r[ind][ind]
            for j in range(0,len(M_r[i])): M_r[ind][j] = M_r[ind][j] / Coeff
            for p in range(0,i):
                ind_n = ind+p+1; Coeff = 1.0*M_r[ind][ind_n]
                for q in range(0,len(M_r[ind])): M_r[ind][q] -= Coeff * M_r[ind_n][q]
    elif Type == "Lower":
        for i in range(0,len(M_r)): 
            Coeff = 1.0*M_r[i][i]
            for j in range(0,len(M_r[i])): M_r[i][j] = M_r[i][j] / Coeff
            for p in range(0,i):
                ind_n = i-p-1; Coeff = 1.0*M_r[i][ind_n]
                for q in range(0,len(M_r[i])): M_r[i][q] -= Coeff * M_r[ind_n][q]
    M_inv = [[0 for j in range(0,len(M[i]))] for i in range(0,len(M))]
    for i in range(0,len(M)): 
        for j in range(0,len(M[i])): M_inv[i][j] = M_r[i][j+len(M)]
    return M_inv 


def Matrix_Inv_LU(M):
    L_r = [[0 for j in range(0,len(M[i]))] for i in range(0,len(M))]
    U_r = [[0 for j in range(0,len(M[i]))] for i in range(0,len(M))]
    for i in range(0,len(M)): 
        U_r[0][i] = M[0][i]
        for j in range(0,len(M[i])): 
            if i == j: L_r[i][j] = 1.0
            elif j == 0: L_r[i][j] = M[i][j] / U_r[0][0]
    for i in range(1,len(M)):
        for j in range(0,len(M[i])):
            if j >= i: 
                U_0 = 0
                for p in range(0,i): U_0 += L_r[i][0+p] * U_r[0+p][j]
                U_r[i][j] = M[i][j] - U_0 
            if j < i and j > 0:
                L_0 = 0
                for q in range(0,j): L_0 += L_r[i][0+q] * U_r[0+q][j]
                L_r[i][j] = (M[i][j] - L_0) / U_r[j][j]
    U_inv = Matrix_Inv_Tri("Upper", U_r)
    L_inv = Matrix_Inv_Tri("Lower", L_r) 
    M_inv = Matrix_Mult(U_inv, L_inv)
    Output = M_inv
    return Output

############################## Spatial Manipulations ########################################
def Joint(Action, Input): 
    if Action == "Add":
        Jt_n = Input[0]; d_Jts = Input[1:]; Jt_m = Jt_n; Jt_p = []
        for i in range(0,len(d_Jts)):
            Jt_p = [Jt_m[0] + d_Jts[i][0], Jt_m[1] + d_Jts[i][1], Jt_m[2] + d_Jts[i][2]]
            Jt_m = Jt_p
        return Jt_m
    elif Action == "Average":
        Jts = Input; Jt_X, Jt_Y, Jt_Z = [], [], []
        for i in range(0,len(Jts)): 
            Jt_X += [Jts[i][0]*1.0]; Jt_Y += [Jts[i][1]*1.0]; Jt_Z += [Jts[i][2]*1.0]
        Jt_Avg = [sum(Jt_X)/len(Jt_X), sum(Jt_Y)/len(Jt_Y), sum(Jt_Z)/len(Jt_Z)]
        return Jt_Avg
    elif Action == "Difference":
        Jt_j, Jt_i = Input
        Jt_n = [Jt_j[0] - Jt_i[0], Jt_j[1] - Jt_i[1], Jt_j[2] - Jt_i[2]]
        return Jt_n

def Dist(Cd_i, Cd_j): #Distance between two joints
    X_i, Y_i, Z_i = Cd_i; X_j, Y_j, Z_j = Cd_j
    Length = math.sqrt((X_i*1.0 - X_j*1.0)**2 + (Y_i*1.0 - Y_j*1.0)**2 + (Z_i*1.0 - Z_j*1.0)**2)
    return Length

def Intp(X_n, X_0, X_1, Y_0, Y_1): #Linear interpolation
    Y_n = (Y_0 * (X_1 - X_n) + Y_1 * (X_n - X_0)) / (X_1 - X_0)
    return Y_n

def Plane_Rot(dX, dY, dZ, A): #Local Coordinates XZ, returns XYZ (dY=0, Y=0)
    dX_0 = dX*1.0*math.cos(A) - dZ*1.0*math.sin(A)
    dZ_0 = dX*1.0*math.sin(A) + dZ*1.0*math.cos(A)
    return [dX_0, 0, dZ_0]

def Plane_Angle(Cd_i, Cd_j): #Angle on XZ plane
    X_i, Y_i, Z_i = Cd_i; X_j, Y_j, Z_j = Cd_j
    d_X, d_Z = (X_j - X_i)*1.0, (Z_j - Z_i)*1.0
    if d_X == 0 and d_Z >= 0: Angle_A = math.pi/2
    elif d_X == 0 and d_Z < 0: Angle_A = 3*math.pi/2
    elif d_X > 0 and d_Z >= 0: Angle_A = math.atan(d_Z/d_X)
    elif d_X > 0 and d_Z < 0: Angle_A = 2*math.pi + math.atan(d_Z/d_X)
    else: Angle_A = math.pi + math.atan(d_Z/d_X)
    Angle_Output = (Angle_A * 180/math.pi % 360) * math.pi/180
    return Angle_Output


############################## Drawing Functions ########################################
def Draw_Arrow(Jt_i, Jt_j, Arrow_Size): #Jt_a at object, Jt_b away
    Angle_B = Plane_Angle(Jt_i, Jt_j)
    Arrow_Dp = Arrow_Size / 3.0
    d_Zp = Plane_Rot(-Arrow_Size, 0.0, Arrow_Dp, Angle_B)
    d_Zn = Plane_Rot(-Arrow_Size, 0.0, -Arrow_Dp, Angle_B)
    Jt_a = Joint("Add", [Jt_j, d_Zp])
    Jt_b = Joint("Add", [Jt_j, d_Zn])
    return Jt_a, Jt_b


def Draw_Arc(Jt_0, Rad, Segments = 24, Start_0 = 0, Rot_0 = math.pi):
    Jts = []
    d_0 = Rot_0*1.0 / Segments
    for i in range(0,Segments+1):
        Angle = Start_0 + d_0 * i
        Jt_n = Plane_Rot(Rad * math.cos(Angle), 0.0, Rad * math.sin(Angle), 0.0)
        Jt_i = Joint("Add", [Jt_0, Jt_n])
        Jts += [Jt_i]
    return Jts


def Draw_Dimension(Jt_i, Jt_j, Dim_Info, Draw_Data):
    Angle_B = Plane_Angle(Jt_i, Jt_j)
    Draw_ind, Colour, Gap, Leader, Ext, Arrow_Size = Dim_Info
    r = Draw_Ref.index(Draw_ind)
    Action = "Model"
    Type = "Line"
    Name = "Dimensions"
    Cyl_Rad = "NA"
    if abs(Angle_B) <= d0_Tol or abs(Angle_B - math.pi) <= d0_Tol: Sign = -1.0
    else: Sign = 1.0
    d_H1 = Plane_Rot(0.0, 0.0, Sign * Gap, Angle_B)
    d_H2 = Plane_Rot(0.0, 0.0, Sign * (Gap + Leader), Angle_B)
    d_H3 = Plane_Rot(0.0, 0.0, Sign * (Gap + Leader + Ext), Angle_B)
    Jt_i1 = Joint("Add", [Jt_i, d_H1])
    Jt_i2 = Joint("Add", [Jt_i, d_H2])
    Jt_i3 = Joint("Add", [Jt_i, d_H3])
    Jt_j1 = Joint("Add", [Jt_j, d_H1])
    Jt_j2 = Joint("Add", [Jt_j, d_H2])
    Jt_j3 = Joint("Add", [Jt_j, d_H3])
    Draw_Info = [Type, Name, Colour, Cyl_Rad, Jt_i1, Jt_i2]; Draw_Data[r] += [Draw_Info]
    Draw_Info = [Type, Name, Colour, Cyl_Rad, Jt_i2, Jt_i3]; Draw_Data[r] += [Draw_Info]
    Draw_Info = [Type, Name, Colour, Cyl_Rad, Jt_j1, Jt_j2]; Draw_Data[r] += [Draw_Info]
    Draw_Info = [Type, Name, Colour, Cyl_Rad, Jt_j2, Jt_j3]; Draw_Data[r] += [Draw_Info]
    Draw_Info = [Type, Name, Colour, Cyl_Rad, Jt_i2, Jt_j2]; Draw_Data[r] += [Draw_Info]
    Jt_a, Jt_b = Draw_Arrow(Jt_i2, Jt_j2, Arrow_Size)
    Draw_Info = [Type, Name, Colour, Cyl_Rad, Jt_a, Jt_j2]; Draw_Data[r] += [Draw_Info]
    Draw_Info = [Type, Name, Colour, Cyl_Rad, Jt_b, Jt_j2]; Draw_Data[r] += [Draw_Info]
    Jt_a, Jt_b = Draw_Arrow(Jt_j2, Jt_i2, Arrow_Size)
    Draw_Info = [Type, Name, Colour, Cyl_Rad, Jt_a, Jt_i2]; Draw_Data[r] += [Draw_Info]
    Draw_Info = [Type, Name, Colour, Cyl_Rad, Jt_b, Jt_i2]; Draw_Data[r] += [Draw_Info]
    MText = str(int(Dist(Jt_i2, Jt_j2)))
    Jt_m = Joint("Average", [Jt_i2, Jt_j2])
    if Angle_B <> 0: d_Text = [-2*Text_Shift_r*len(MText)*Text_Size, 0, 0]
    else: d_Text = [-Text_Shift_r*len(MText)*Text_Size, 0, 0]
    Jt_mr = Joint("Add", [Jt_m, d_Text])
    Text_Info = Jt_mr, MText, Draw_ind
    Draw_Text(Action, "Dimensions", Text_Info, Draw_Data)


def Draw_Text(Action, Type, Text_Info, Draw_Data):
    Jt_m, MText, Draw_ind = Text_Info
    r = Draw_Ref.index(Draw_ind)
    Shift_X = -len(MText) * Text_Shift_r * Text_Size #Default centre
    Shift_Y = 0; Shift_Z = 0
    Name_Type = Type
    if Type == "Title": Name_Type = Action; Shift_X = 0
    elif Type == "Member Load": Shift_Z += 1.0 * Text_Size
    elif Type == "Joint Name": MText = "[" + MText + "]"; Shift_X += 1.0 * Text_Size; Shift_Z += 1.0 * Text_Size
    elif Type == "Member Name V": Shift_X = 0
    elif Type == "Member Name H": Shift_X += Text_Size; Shift_Z += 1.5 * Text_Size
    elif Type == "BMD Max": Name_Type = Type[:3]
    elif Type == "Result": Shift_X = 0
    elif Type == "Applied Force": Shift_X = Text_Size / 2.0; Shift_Z = Text_Size / 2.0
    elif Type == "Applied Moment": Shift_Z = -Text_Size
    elif Type == "Dimensions": Shift_X = 0
    elif Type in ["AFD i -", "SFD i -", "BMD i -"]:
        Name_Type = Type[:3]
        Shift_X = Text_Size / 2.0
        Shift_Z += -0.5 * Text_Size
    elif Type in ["AFD i +", "SFD i +", "BMD i +"]:
        Name_Type = Type[:3]
        Shift_X = Text_Size / 2.0
        Shift_Z += 0.5 * Text_Size
    elif Type in ["AFD j -", "SFD j -", "BMD j -"]:
        Name_Type = Type[:3]
        Shift_X = -2 * len(MText) * Text_Shift_r * Text_Size
        Shift_Z += -0.5 * Text_Size
    elif Type in ["AFD j +", "SFD j +", "BMD j +"]:
        Name_Type = Type[:3]
        Shift_X = -2 * len(MText) * Text_Shift_r * Text_Size
        Shift_Z += 0.5 * Text_Size
    d_Jt_t = [Shift_X, Shift_Y, Shift_Z]
    d_Jt_D = [0, 0, -Dynamo_Offset]
    Jt_t = Joint("Add", [Jt_m, d_Jt_t])
    Jt_D = Joint("Add", [Jt_t, d_Jt_D])
    Draw_Info = ["Text", Name_Type, MText, Jt_t, Jt_D]; Draw_Data[r] += [Draw_Info]


def Draw_Support(Action, Jt_0, Draw_Info, Draw_Data):
    Draw_ind = "Framing"
    Name_ind = "Dimensions"
    r = Draw_Ref.index(Draw_ind)
    Name, Colour, Size, Restraint = Draw_Info
    MText = str(Name)
    Text_Info = [Jt_0, MText, Name_ind]
    Draw_Text(Action, "Joint Name", Text_Info, Draw_Data)
    Cyl_Rad = "NA"
    Solid_Colour = "Orange"
    Draw_Info = ["Sphere", Name, Solid_Colour, Sphere_Rad, Jt_0]; Draw_Data[r] += [Draw_Info]
    if Restraint == ["R", "R", "R"]: #Fixed
        d_Xn = [-Size, 0, -Size/2.0]
        d_Xp = [Size, 0, -Size/2.0]
        Jt_1 = Joint("Add", [Jt_0, d_Xn])
        Jt_2 = Joint("Add", [Jt_0, d_Xp])
        Type = "Line"
        Colour = "Black"
        Draw_Info = [Type, Name, Colour, Cyl_Rad, Jt_1, Jt_2]; Draw_Data[r] += [Draw_Info]
        Jt_12 = Joint("Average", [Jt_1, Jt_2])
        Draw_Info = [Type, Name, Colour, Cyl_Rad, Jt_0, Jt_12]; Draw_Data[r] += [Draw_Info]
    elif Restraint == ["R", "R", "F"] or Restraint == ["F", "R", "F"]: #Pinned, Roller
        d_Jtn = [-Size, 0, -Size]
        d_Jtp = [Size, 0, -Size]
        Jt_1 = Joint("Add", [Jt_0, d_Jtn])
        Jt_2 = Joint("Add", [Jt_0, d_Jtp])
        Type = "Line"
        Colour = "Black"
        Draw_Info = [Type, Name, Colour, Cyl_Rad, Jt_1, Jt_2]; Draw_Data[r] += [Draw_Info]
        Draw_Info = [Type, Name, Colour, Cyl_Rad, Jt_0, Jt_1]; Draw_Data[r] += [Draw_Info]
        Draw_Info = [Type, Name, Colour, Cyl_Rad, Jt_0, Jt_2]; Draw_Data[r] += [Draw_Info]
        Jt_0a = Joint("Average", [Jt_1, Jt_2])
        Jt_1a = Joint("Average", [Jt_0a, Jt_1])
        Jt_2a = Joint("Average", [Jt_0a, Jt_2])
        if Restraint == ["F", "R", "F"]:
            Type = "Circle"
            Colour = "Black"
            Circle_Rad = Size/4.0
            Dir = [0, 1, 0]
            Jt_ref = [Jt_1a, Jt_2a]
            for i in range(0,2):
                d_Z = [0.0, 0.0, -Circle_Rad]
                Jt_c = Joint("Add", [Jt_ref[i], d_Z])
                Draw_Info = [Type, Name, Colour, Circle_Rad, Dir, Jt_c]; Draw_Data[r] += [Draw_Info]  
    if Restraint == ["R", "R", "R"] or Restraint == ["R", "R", "F"]: #Pinned
        Type = "Line"
        Segments = 4
        d_L = 1.0*Dist(Jt_1, Jt_2) / Segments
        d_S = [-d_L*2.0/3, 0, -d_L*2.0/3]  
        for i in range(0,Segments):
            d_Jt_1 = [d_L*i, 0, 0]
            d_Jt_2 = [d_L*(i+1), 0, 0]
            Jt_1b = Joint("Add", [Jt_1, d_Jt_1])
            Jt_2b = Joint("Add", [Jt_1, d_Jt_2])
            Jt_12 = Joint("Average", [Jt_1b, Jt_2b])
            Jt_23 = Joint("Add", [Jt_12, d_S])
            Draw_Info = [Type, Name, Colour, Cyl_Rad, Jt_12, Jt_23]; Draw_Data[r] += [Draw_Info]


def Ansys_UDL(Jt_1, Jt_2, Size, Segments = 10):
    Angle_B = Plane_Angle(Jt_1, Jt_2)
    d_Zi = Size + Text_Size
    d_Jt_Z = Plane_Rot(0.0, 0.0, d_Zi, Angle_B)
    Jt_1r = Joint("Add", [Jt_1, d_Jt_Z])
    Jt_2r = Joint("Add", [Jt_2, d_Jt_Z])
    d_L = Dist(Jt_1r, Jt_2r) * 1.0 / Segments
    Jts = []
    for i in range(0,Segments+1):
        d_Jt_Li = Plane_Rot(d_L * i, 0.0, 0.0, Angle_B)
        d_Jt_Lj = Plane_Rot(d_L * i, 0.0, -Size, Angle_B)
        Jt_i = Joint("Add", [Jt_1r, d_Jt_Li])
        Jt_j = Joint("Add", [Jt_1r, d_Jt_Lj])
        Jts += [[Jt_i, Jt_j]]
    return Jts


def Ansys_Loads(Action, Draw_Info, Draw_Data):
    if Action == "Model Reaction": r = Draw_ind = "Reactions"; Text_Action = "Model"
    else: Draw_ind = "Applied Loads"; Text_Action = "Model"
    r = Draw_Ref.index(Draw_ind)
    Cyl_Rad = "NA"; Type = "Line"
    if Action in ["Model Member"]:
        Name, Colour, Jt_1, Jt_2, Mbr_UDL, Arrow_Size = Draw_Info
        Shift = Arrow_Size; Arrow_Len = Arrow_Size * 2.5; Arrow_Head = Arrow_Size
        if Mbr_UDL <> 0:
            Segments = 10
            UDL_Size = Arrow_Len
            Jts = Ansys_UDL(Jt_1, Jt_2, UDL_Size, Segments)
            Jt_i, Jt_j = Jts[0][0], Jts[-1][0]
            Draw_Info = [Type, Name, Colour, Cyl_Rad, Jt_i, Jt_j]; Draw_Data[r] += [Draw_Info]
            Jt_m = Joint("Average", [Jt_i, Jt_j])
            MText = str(round(Mbr_UDL,2)) + " kN/m"
            Text_Info = [Jt_m, MText, Draw_ind]
            Draw_Text(Text_Action, "Member Load", Text_Info, Draw_Data)
            for i in range(0,len(Jts)): #Jt_i, Jt_j = Jts[i]
                if Mbr_UDL > 0: Jt_i, Jt_j = Jts[i]
                else: Jt_j, Jt_i = Jts[i]
                Jt_a, Jt_b = Draw_Arrow(Jt_i, Jt_j, Arrow_Head)
                Draw_Info = [Type, Name, Colour, Cyl_Rad, Jt_i, Jt_j]; Draw_Data[r] += [Draw_Info]
                Draw_Info = [Type, Name, Colour, Cyl_Rad, Jt_a, Jt_j]; Draw_Data[r] += [Draw_Info]
                Draw_Info = [Type, Name, Colour, Cyl_Rad, Jt_b, Jt_j]; Draw_Data[r] += [Draw_Info]
    elif Action in ["Model Joint", "Model Reaction"]:
        if Action == "Model Joint": 
            Name, Colour, Coord, Forces, Arrow_Size, Draw_Dir = Draw_Info
            Restraint = ["R", "R", "R"] #Dummy
            Start_0 = math.pi/4
            Rot_0 = math.pi
            Shift = Arrow_Size
            Arrow_Len = Arrow_Size * 5.0
            Arrow_Head = Arrow_Size
        elif Action == "Model Reaction":
            Name, Colour, Coord, Reaction, Defl, Restraint, Arrow_Size, Draw_Dir = Draw_Info
            Forces = Reaction
            if Reaction[-1] > 0: Start_0 = math.pi/2; Rot_0 = math.pi
            else: Start_0 = math.pi/2; Rot_0 = -math.pi #* 5.0/4
            Shift = Arrow_Size
            Arrow_Len = Arrow_Size * 5.0
            Arrow_Head = Arrow_Size
            MText_List = [] #Reaction/Defl Text
            for i in range(0,3):
                if Restraint[i] == "F":
                    if i == 0: MText = "dx = " + str(round(Defl[i]*1000,2)) + " mm"
                    elif i == 1: MText = "dy = " + str(round(Defl[i]*1000,2)) + " mm"
                    elif i == 2: MText = "dr = " + str(round(Defl[i]*1000,3)) + " rad"
                    MText_List += [MText]
                else:
                    if i == 0: MText = "Rx = " + str(round(Reaction[i],1)) + " kN"
                    elif i == 1: MText = "Ry = " + str(round(Reaction[i],1)) + " kN"
                    elif i == 2: MText = "M = " + str(round(Reaction[i],1)) + " kNm" 
                    MText_List += [MText]
            for i in range(0,3):
                d_Jt_m = [Text_Size/2.0, 0, -Text_Size * (i+0.5)]
                if "R" in Restraint and Draw_Dir == "L": d_Jt_m = [-(len(MText_List[-1])) *2* Text_Shift_r * Text_Size, 0, -Text_Size * (i+1)]
                elif "R" in Restraint and Draw_Dir == "R": d_Jt_m = [Text_Size, 0, -Text_Size * (i+1)]     
                Jt_m = Joint("Add", [Coord, d_Jt_m])
                MText = MText_List[i]
                Text_Info = [Jt_m, MText, Draw_ind]
                Draw_Text(Text_Action, "Result", Text_Info, Draw_Data)
        for i in range(0,3):
            if Forces[i] <> 0 and Restraint[i] == "R":
                if i == 2:
                    Rad = 500
                    Segments = 24 #10
                    Jts = Draw_Arc(Coord, Rad, Segments, Start_0, Rot_0)
                    if "Joint" in Action:
                        MText = str(round(Forces[i],2)) + " kNm"
                        Text_Info = [Jt_m, MText, Draw_ind]
                        Draw_Text(Text_Action, "Applied Moment", Text_Info, Draw_Data)
                    for j in range(0,len(Jts)-1):
                        Jt_i, Jt_j = Jts[j], Jts[j+1]
                        Draw_Info = [Type, Name, Colour, Cyl_Rad, Jt_i, Jt_j]; Draw_Data[r] += [Draw_Info]
                        if j == 0:
                            Jt_a, Jt_b = Draw_Arrow(Jt_j, Jt_i, Arrow_Head)
                            Draw_Info = [Type, Name, Colour, Cyl_Rad, Jt_a, Jt_i]; Draw_Data[r] += [Draw_Info]
                            Draw_Info = [Type, Name, Colour, Cyl_Rad, Jt_b, Jt_i]; Draw_Data[r] += [Draw_Info]
                else:
                    if i == 0: 
                        if Draw_Dir == "R": L_1 = Shift; L_2 = Shift + Arrow_Len
                        else: L_2 = -Shift; L_1 = -(Shift + Arrow_Len)
                        d_1 = [L_1, 0, 0]; d_2 = [L_2, 0, 0]
                    else: 
                        if "Reaction" in Action: L_2 = -Shift; L_1 = -(Shift + Arrow_Len)
                        else: L_1 = Shift; L_2 = Shift + Arrow_Len 
                        d_1 = [0, 0, L_1]; d_2 = [0, 0, L_2]
                    Jt_1 = Joint("Add", [Coord, d_1])
                    Jt_2 = Joint("Add", [Coord, d_2])
                    Jt_i = Jt_2; Jt_j = Jt_1
                    if Forces[i] > 0: Jt_i = Jt_1; Jt_j = Jt_2
                    Jt_a, Jt_b = Draw_Arrow(Jt_i, Jt_j, Arrow_Head)
                    Draw_Info = [Type, Name, Colour, Cyl_Rad, Jt_i, Jt_j]; Draw_Data[r] += [Draw_Info]
                    Draw_Info = [Type, Name, Colour, Cyl_Rad, Jt_a, Jt_j]; Draw_Data[r] += [Draw_Info]
                    Draw_Info = [Type, Name, Colour, Cyl_Rad, Jt_b, Jt_j]; Draw_Data[r] += [Draw_Info]
                    if "Joint" in Action:
                        MText = str(round(Forces[i],2)) + " kN"
                        Jt_m = Jt_j #Calculate.Joint("Average", [Jt_i, Jt_j])
                        if Forces[i] < 0 or (Forces[i] > 0 and Draw_Dir == "L"): 
                            if i == 0: d_Jt_m = [-(len(MText)+1) * Text_Shift_r * Text_Size, 0, 0]
                            else: d_Jt_m = [0,0,0]
                            Jt_m = Joint("Add", [Jt_i, d_Jt_m])
                        Text_Info = [Jt_m, MText, Draw_ind]
                        Draw_Text(Text_Action, "Applied Force", Text_Info, Draw_Data)
                                
                        
def Frame_Member(Action, Member_Info, Draw_Data, Mbr_Text = "On"):
    Draw_ind = "Framing"; Name_ind = "Dimensions"
    r = Draw_Ref.index(Draw_ind)
    Mbr_Name, Colour, Cyl_Rad, Jt_1, Jt_2 = Member_Info
    Angle_B = Plane_Angle(Jt_1, Jt_2)
    Type = "Line"
    Draw_Info = [Type, Mbr_Name, Colour, Cyl_Rad, Jt_1, Jt_2]; Draw_Data[r] += [Draw_Info]
    Solid_Colour = "Orange"
    Mbr_Dir = Joint("Difference", [Jt_2, Jt_1])
    d_Dp = Plane_Rot(0.0, 0.0, Dim_D/2.0, Angle_B)
    d_Dn = Plane_Rot(0.0, 0.0, -Dim_D/2.0, Angle_B)  
    d_Bp = [0.0, Dim_B/2.0, 0.0]
    d_Bn = [0.0, -Dim_B/2.0, 0.0]
    Jt_A = Joint("Add", [Jt_1, d_Dp, d_Bp])
    Jt_B = Joint("Add", [Jt_1, d_Dp, d_Bn])
    Jt_C = Joint("Add", [Jt_1, d_Dn, d_Bn])
    Jt_D = Joint("Add", [Jt_1, d_Dn, d_Bp])
    Mbr_Jts = [Jt_A, Jt_B, Jt_C, Jt_D]
    Draw_Info = ["Cuboid", Mbr_Name, Solid_Colour, Mbr_Jts, Mbr_Dir]; Draw_Data[r] += [Draw_Info]
    if Mbr_Text == "On":
        if abs(Angle_B) <= d0_Tol or abs(Angle_B - math.pi) <= d0_Tol: Text_Type = "Member Name H"
        else: Text_Type = "Member Name V"
        Jt_m = Joint("Average", [Jt_1, Jt_2])
        MText = str(Mbr_Name)
        Text_Info = [Jt_m, MText, Name_ind]
        Draw_Text(Action, Text_Type, Text_Info, Draw_Data)
         
       
def Ansys_Internal_Forces(Action, Jt_i, Jt_j, Draw_Info, Draw_Data):
    Mbr_Name, Mbr_UDL, Mbr_Forces, Force_Scale = Draw_Info
    Draw_ind = "Internal Forces"; Text_Action = "Model"
    r = Draw_Ref.index(Draw_ind)
    Angle_B = Plane_Angle(Jt_i, Jt_j)
    AFD_Sign = 1.0 
    SFD_Sign = 1.0 
    BMD_Sign = -1.0 #Plot Negative on +Z Axis
    Def_Scale = 100.0
    P_Scale, V_Scale, M_Scale = Force_Scale
    GP_i, GV_i, GM_i, GP_j, GV_j, GM_j = Mbr_Forces
    P_i = 1.0 * GP_i; P_j = -1.0 * GP_j; V_i = 1.0 * GV_i; V_j = -1.0 * GV_j; M_i = -1.0 * GM_i; M_j = 1.0 * GM_j
    d_Pi = Plane_Rot(0.0, 0.0, AFD_Sign * P_i * P_Scale * Def_Scale, Angle_B)  
    d_Vi = Plane_Rot(0.0, 0.0, SFD_Sign * V_i * V_Scale * Def_Scale, Angle_B)  
    d_Mi = Plane_Rot(0.0, 0.0, BMD_Sign * M_i * M_Scale * Def_Scale, Angle_B)  
    d_Pj = Plane_Rot(0.0, 0.0, AFD_Sign * P_j * P_Scale * Def_Scale, Angle_B)  
    d_Vj = Plane_Rot(0.0, 0.0, SFD_Sign * V_j * V_Scale * Def_Scale, Angle_B)  
    d_Mj = Plane_Rot(0.0, 0.0, BMD_Sign * M_j * M_Scale * Def_Scale, Angle_B) 
    Name = Mbr_Name
    Cyl_Rad = "NA"
    if Action == "Model Axial":
        Type = "AFD"
        Colour = "Green"
        Jt_1 = Joint("Add", [Jt_i, d_Pi])
        Jt_2 = Joint("Add", [Jt_j, d_Pj])
        Draw_Info = [Type, Name, Colour, Cyl_Rad, Jt_1, Jt_2]; Draw_Data[r] += [Draw_Info]
        if Dist(Jt_1, Jt_i) > dr_Tol: 
            Draw_Info = [Type, Name, Colour, Cyl_Rad, Jt_i, Jt_1]; Draw_Data[r] += [Draw_Info]
            if P_i > 0: Text_Type = "AFD i +"
            else: Text_Type = "AFD i -"
            MText = str(round(P_i,2)) + " kN"
            Text_Info = [Jt_1, MText, Draw_ind]
            Draw_Text(Text_Action, Text_Type, Text_Info, Draw_Data)
        if Dist(Jt_2, Jt_j) > dr_Tol: 
            Draw_Info = [Type, Name, Colour, Cyl_Rad, Jt_2, Jt_j]; Draw_Data[r] += [Draw_Info]
            if abs(P_i - P_j) > dr_Tol:
                if P_j > 0: Text_Type = "AFD j +"
                else: Text_Type = "AFD j -"
                MText = str(round(P_j,2)) + " kN"
                Text_Info = [Jt_2, MText, Draw_ind]
                Draw_Text(Text_Action, Text_Type, Text_Info, Draw_Data)
    elif Action == "Model Shear":
        Type = "SFD"
        Colour = "Blue"
        Jt_1 = Joint("Add", [Jt_i, d_Vi])
        Jt_2 = Joint("Add", [Jt_j, d_Vj])
        Draw_Info = [Type, Name, Colour, Cyl_Rad, Jt_1, Jt_2]; Draw_Data[r] += [Draw_Info]
        if Dist(Jt_1, Jt_i) > dr_Tol: 
            Draw_Info = [Type, Name, Colour, Cyl_Rad, Jt_i, Jt_1]; Draw_Data[r] += [Draw_Info]
            if V_i > 0: Text_Type = "SFD i +"
            else: Text_Type = "SFD i -"
            MText = str(round(V_i,2)) + " kN"
            Text_Info = [Jt_1, MText, Draw_ind]
            Draw_Text(Text_Action, Text_Type, Text_Info, Draw_Data)
        if Dist(Jt_2, Jt_j) > dr_Tol: 
            Draw_Info = [Type, Name, Colour, Cyl_Rad, Jt_2, Jt_j]; Draw_Data[r] += [Draw_Info]
            if abs(V_i - V_j) > dr_Tol:
                if V_j > 0: Text_Type = "SFD j +"
                else: Text_Type = "SFD j -"
                MText = str(round(V_j,2)) + " kN"
                Text_Info = [Jt_2, MText, Draw_ind]
                Draw_Text(Text_Action, Text_Type, Text_Info, Draw_Data)
    elif Action == "Model Bending":
        Type = "BMD"
        Colour = "Red"
        Jt_1 = Joint("Add", [Jt_i, d_Mi])
        Jt_2 = Joint("Add", [Jt_j, d_Mj])
        if Dist(Jt_1, Jt_i) > dr_Tol: 
            Draw_Info = [Type, Name, Colour, Cyl_Rad, Jt_i, Jt_1]; Draw_Data[r] += [Draw_Info]
            if M_i > 0: Text_Type = "BMD i -" #Plot on top
            else: Text_Type = "BMD i +"
            MText = str(round(M_i,2)) + " kNm"
            Text_Info = [Jt_1, MText, Draw_ind]
            Draw_Text(Text_Action, Text_Type, Text_Info, Draw_Data)
        if Dist(Jt_2, Jt_j) > dr_Tol: 
            Draw_Info = [Type, Name, Colour, Cyl_Rad, Jt_2, Jt_j]; Draw_Data[r] += [Draw_Info]
            if M_j > 0: Text_Type = "BMD j -"
            else: Text_Type = "BMD j +"
            MText = str(round(M_j,2)) + " kNm"
            Text_Info = [Jt_2, MText, Draw_ind]
            Draw_Text(Text_Action, Text_Type, Text_Info, Draw_Data)
        if Mbr_UDL <> 0: #Draw Quadratic BMD Curve
            BMD_Abs = []
            BMD_List = []
            BMD_Jt = []
            Segments = 8
            Len = Dist(Jt_i, Jt_j) / 1000.0
            d_L = Len*1.0 / Segments
            for i in range(0,Segments):
                M_1 = Intp(d_L*i, 0.0, Len, M_i, M_j)
                M_2 = Intp(d_L*(i+1), 0.0, Len, M_i, M_j)
                M_x1 = M_1 + Mbr_UDL * d_L*i / 2.0 * (Len - d_L*i)
                M_x2 = M_2 + Mbr_UDL * d_L*(i+1) / 2.0 * (Len - d_L*(i+1))
                d_M1 = Plane_Rot(0.0, 0.0, BMD_Sign * M_x1 * M_Scale * Def_Scale, Angle_B)  
                d_M2 = Plane_Rot(0.0, 0.0, BMD_Sign * M_x2 * M_Scale * Def_Scale, Angle_B)  
                d_1m = Plane_Rot(d_L*i * 1000.0, 0.0, 0.0, Angle_B) 
                d_2m = Plane_Rot(d_L*(i+1) * 1000.0, 0.0, 0.0, Angle_B) 
                Jt_1m = Joint("Add", [Jt_i, d_1m, d_M1])
                Jt_2m = Joint("Add", [Jt_i, d_2m, d_M2])
                Draw_Info = [Type, Name, Colour, Cyl_Rad, Jt_1m, Jt_2m]; Draw_Data[r] += [Draw_Info]
                if i < Segments-1: BMD_Abs += [abs(M_x2)]; BMD_List += [M_x2]; BMD_Jt += [Jt_2m]
            BMD_List_Sort, BMD_Jt_Sort = zip(*sorted(zip(BMD_List, BMD_Jt)))
            if BMD_List_Sort[0] < min(M_i, M_j):
                MText = str(round(BMD_List_Sort[0],2)) + " kNm"
                Jt_t = BMD_Jt_Sort[0]
                Text_Info = [Jt_t, MText, Draw_ind]
                Draw_Text(Text_Action, "BMD Max", Text_Info, Draw_Data)
            if BMD_List_Sort[-1] > max(M_i, M_j):
                MText = str(round(BMD_List_Sort[-1],2)) + " kNm"
                Jt_t = BMD_Jt_Sort[-1]
                Text_Info = [Jt_t, MText, Draw_ind]
                Draw_Text(Text_Action, "BMD Max", Text_Info, Draw_Data)
        else: Draw_Info = [Type, Name, Colour, Cyl_Rad, Jt_1, Jt_2]; Draw_Data[r] += [Draw_Info]

    
############################## Run Functions ########################################

Frame_Draw("Initial", Jt_Info, Mbr_Info, Force_Scale, Draw_Data)

Mbr_Info_r, Inv_K, Gl_K_f, Gl_D, Gl_F = Frame_Analysis(Jt_Info, Mbr_Info)

Frame_Draw("Results", Jt_Info, Mbr_Info_r, Force_Scale, Draw_Data)

Results = [Inv_K, Gl_D, Gl_F, Jt_Info, Mbr_Info_r]

# Assign your output to the OUT variable.
OUT = Draw_Data, Results
# ----------------------------------------

# group: Analysis Results
str_analysis_results = CodeBlock(IN=structural_analysis) { Results = IN[1]; }
inv_global_k_matrix = CodeBlock(IN=str_analysis_results) { IN[0]; }
global_disp_in_m_and_rad = CodeBlock(IN=str_analysis_results) { IN[1]; }
global_force_in_kn_and_knm = CodeBlock(IN=str_analysis_results) { IN[2]; }
joint_info = CodeBlock(IN=str_analysis_results) { IN[3]; }
member_info = CodeBlock(IN=str_analysis_results) { IN[4]; }

# group: XYZ Axes at (0, 0, 0)
axes_length = DoubleSlider(5000, range=0..20000 step 500)
axes_radius = DoubleSlider(100, range=0..500 step 50)
xyz_axes = Python(IN[0]=axes_length, IN[1]=axes_radius)
# ---------- xyz_axes.python (28 lines) ----------
# Enable Python support and load DesignScript library
import clr
import math
clr.AddReference('ProtoGeometry')
from Autodesk.DesignScript.Geometry import *

# The inputs to this node will be stored as a list in the IN variables.
dataEnteringNode = IN

# Place your code below this line
Size = IN[0]
Rad = IN[1]
AO = [-10000, 0, 0] #Axis_Origin

P_0 = Point.ByCoordinates(AO[0], AO[1], AO[2])
P_X = Point.ByCoordinates(AO[0] + Size, AO[1], AO[2])
P_Y = Point.ByCoordinates(AO[0], AO[1] + Size, AO[2])
P_Z = Point.ByCoordinates(AO[0], AO[1], AO[2] + Size)

C_X = Cylinder.ByPointsRadius(P_0, P_X, Rad)
C_Y = Cylinder.ByPointsRadius(P_0, P_Y, Rad)
C_Z = Cylinder.ByPointsRadius(P_0, P_Z, Rad)
C_0 = Sphere.ByCenterPointRadius(P_0, Rad*2)

XYZ_Axes = [C_X, C_Y, C_Z, C_0]

# Assign your output to the OUT variable.
OUT = XYZ_Axes
# ----------------------------------------
x_axis = ColorPalette({R: 255, G: 0, B: 0, A: 255})
y_axis = ColorPalette({R: 127, G: 255, B: 0, A: 255})
z_axis = ColorPalette({R: 65, G: 105, B: 225, A: 255})
origin = ColorPalette({R: 153, G: 50, B: 204, A: 255})
list_create = List.Create(item0=x_axis, item1=y_axis, item2=z_axis, item3=origin)
byGeometryColor = Modifiers.GeometryColor.ByGeometryColor(geometry=xyz_axes, color=list_create)

# group: Output Control
show_applied_loads = BoolSelector(true)
show_dimension = BoolSelector(true)
show_afd = BoolSelector(false)
show_sfd = BoolSelector(false)
show_bmd = BoolSelector(false)
show_reactions = BoolSelector(false)
show_control = CodeBlock(Ld=show_applied_loads, Dim=show_dimension, AFD=show_afd, SFD=show_sfd, BMD=show_bmd, Rct=show_reactions)
# ---------- show_control.designscript (4 lines) ----------
Ctrl =
[Ld, Dim,
AFD, SFD,
BMD, Rct];
# ----------------------------------------

# group: Draw in Dynamo
draw_data = CodeBlock(IN=structural_analysis) { Draw_Data = IN[0]; }
draw_model = Python(IN[0]=draw_data, IN[1]=show_control)
# ---------- draw_model.python (110 lines) ----------
# Load the Python Standard and DesignScript Libraries
import clr
clr.AddReference('ProtoGeometry')
from Autodesk.DesignScript.Geometry import *
import math

# The inputs to this node will be stored as a list in the IN variables.
dataEnteringNode = IN

Draw_Data = IN[0]
Show_Ctrl = IN[1]
Show_Ld, Show_Dim, Show_AFD, Show_SFD, Show_BMD, Show_Rct = Show_Ctrl

Draw_Obj = []
Colour_Obj = [[] for i in range(0,3)]
Text_Obj = [[] for j in range(0,3)]

def Colour_Code(Colour_Name):
    Colour_Code = [ [255,0,0], [255,0,255], [0,0,255], [0,255,255], [0,255,0], 
    				[255,255,0], [130, 100, 255], [75, 200, 200], [0, 100, 0],
                    [255,130,0], [0,0,0], [255,255,255], [0,130,0], [255,180,180], [125, 125, 125]]       
    Colour_List = [ "Red", "Purple", "Blue", "Teal", "Green", 
    				"Yellow", "Violet", "Turquoise", "Forest",
                    "Orange", "Black", "White", "Basil", "Pink", "Grey"]
    Def_Colour = [0,0,0] #"Black"
    if Colour_Name in Colour_List: n = Colour_List.index(Colour_Name); Output = Colour_Code[n]
    else: Output = Def_Colour
    return Output
    
def Draw_Pt(Cd):
    return Point.ByCoordinates(Cd[0], Cd[1], Cd[2])
    
def Draw_Vn(VN): #reminder to adjust to global angle
    return Vector.ByCoordinates(VN[0], VN[1], VN[2])
    
def Draw_Pts(Cds):
    Pts = []
    for i in range(0,len(Cds)): Pts += [Point.ByCoordinates(Cds[i][0], Cds[i][1], Cds[i][2])]
    return Pts
    
def Draw_Colour(Colour_Name, Colour_Obj):
    R_Col, G_Col, B_Col = Colour_Code(Colour_Name)
    Colour_Obj[0] += [R_Col]
    Colour_Obj[1] += [G_Col]
    Colour_Obj[2] += [B_Col]


Draw_Ref = ["Framing", "Applied Loads", "Internal Forces", "Reactions", "Dimensions"]
for r in range(0,len(Draw_Ref)):
	Show = 0
	if r == 0: Show = 1
	if r == 1 and Show_Ld == True: Show = 1
	elif r == 2 and (Show_AFD == True or Show_SFD == True or Show_BMD == True): Show = 1
	elif r == 3 and Show_Rct == True: Show = 1
	elif r == 4 and Show_Dim == True: Show = 1
	if Show == 1:
		for i in range(0,len(Draw_Data[r])):
			Type = Draw_Data[r][i][0]
			if Type == "Text":
				Type, Name, MText, Jt_t, Jt_D = Draw_Data[r][i]
				Show_Text = 1
				if r == 2:
					Show_Text = 0
					if Name == "AFD" and Show_AFD == True: Show_Text = 1
					if Name == "SFD" and Show_SFD == True: Show_Text = 1
					if Name == "BMD" and Show_BMD == True: Show_Text = 1
				if Show_Text == 1:
					Text_Obj[0] += [Draw_Pt(Jt_D)]
					Text_Obj[1] += [Draw_Pt(Jt_t)]
					if isinstance(MText, float) == True: Text_Obj[2] += [str(int(MText))]
					else: Text_Obj[2] += [str(MText)] 
				
			elif Type == "Circle" or Type == "Joint":
				Type, Name, Colour, Circle_Rad, Dir, Jt_0 = Draw_Data[r][i]
				Vector = Draw_Vn(Dir)
				Pt_0 = Draw_Pt(Jt_0)
				Circle = Circle.ByCenterPointRadiusNormal(Pt_0, Circle_Rad, Vector)
				Draw_Obj += [Circle]
				Draw_Colour(Colour, Colour_Obj)
				
			elif Type in ["Line", "Outline", "AFD", "SFD", "BMD"]:
				Type, Name, Colour, Cyl_Rad, Jt_1, Jt_2 = Draw_Data[r][i]
				Pt_1 = Draw_Pt(Jt_1); Pt_2 = Draw_Pt(Jt_2)
				Draw_Line = 1
				if r == 2:
					Draw_Line = 0
					if Type == "AFD" and Show_AFD == True: Draw_Line = 1
					if Type == "SFD" and Show_SFD == True: Draw_Line = 1
					if Type == "BMD" and Show_BMD == True: Draw_Line = 1
				if Draw_Line == 1:
					Draw_Obj += [Line.ByStartPointEndPoint(Pt_1, Pt_2)] 
					Draw_Colour(Colour, Colour_Obj)
			
			elif Type == "Cuboid":
				Type, Name, Colour, Mbr_Pts, Mbr_Dir = Draw_Data[r][i]
				Pts = Draw_Pts(Mbr_Pts)
				VC = Draw_Vn(Mbr_Dir)
				PL = Polygon.ByPoints(Pts)
				Draw_Obj += [Curve.ExtrudeAsSolid(PL, VC)]
				Draw_Colour(Colour, Colour_Obj)
				
			elif Type == "Sphere":
				Type, Name, Colour, Sphere_Rad, Jt_0 = Draw_Data[r][i]
				Pt_0 = Draw_Pt(Jt_0)
				Draw_Obj += [Sphere.ByCenterPointRadius(Pt_0, Sphere_Rad)]
				Draw_Colour(Colour, Colour_Obj)
				
# Assign your output to the OUT variable.

OUT = [Draw_Obj, Colour_Obj, Text_Obj]
# ----------------------------------------
draw_funcfr = CodeBlock(IN=draw_model) { Draw_Obj = IN[0]; }
draw_funcfr_2 = CodeBlock(IN=draw_model) { Colour_R = IN[1][0]; Colour_G = IN[1][1]; Colour_B = IN[1][2]; }
byARGB = Color.ByARGB(r=draw_funcfr_2.Colour_R, g=draw_funcfr_2.Colour_G, b=draw_funcfr_2.Colour_B)
byGeometryColor_2 = Modifiers.GeometryColor.ByGeometryColor(geometry=draw_funcfr, color=byARGB)
draw_text = CodeBlock(IN=draw_model) { Text_Data = IN[2]; }

# group: Text in Dynamo
views = Views("PDF")
draw_text_2 = CodeBlock(IN=draw_text) { Dyn_2D = IN[0]; Loc_2D = IN[1]; Text_2D = IN[2]; }
horizontal_alignment_style = HorizontalAlignmentStyleUi("Left")
byLocation = TextNote.ByLocation(view=views, location=draw_text_2.Loc_2D, text=draw_text_2.Text_2D, alignment=horizontal_alignment_style)
text = TextNote.Text(textNote=byLocation)
code_block_3 = CodeBlock { Size = 420; }
fromStringOriginAndScale = DynamoText.Text.FromStringOriginAndScale(text=text, origin=draw_text_2.Dyn_2D, scale=code_block_3)
code_block_4 = CodeBlock { Vector.XAxis(); 90; }
rotate = Geometry.Rotate(geometry=fromStringOriginAndScale, origin=draw_text_2.Dyn_2D, axis=code_block_4.out0, degrees=code_block_4.out1)
color_palette = ColorPalette({R: 0, G: 0, B: 0, A: 255})
byGeometryColor_3 = Modifiers.GeometryColor.ByGeometryColor(geometry=rotate, color=color_palette)
